% Simulink data dictionary modelDictionary.sldd

Ts = 1.0e-6
switch_subsysctrl = 1
Motor_Pn = 4
MPTA_SubSysCtrl = 0
switch_electronic_feedworward = 0
Motor_Ld_Indctances = 0.00525
Motor_Lq_Indctances = 0.00012
Motor_flux = 0.1827
Motor_Rs = 0.958
Sig = Simulink.Signal()